# Grasshopper definition test_minimal.gh (Grasshopper 1.0.8)

get_geometry = GetGeometry(AnnotationTypeFilter=3966, AtLeast=1, AtMost=1, DeleteInput=False, Filter=1074081855, TreeAccess=False)
curves = Curve(get_geometry)
area = Area(Geometry=curves)  # -> Area, Centroid
deconstruct = Deconstruct(Point=area.Centroid)  # -> XComponent, YComponent, ZComponent
construct_point = ConstructPoint(XCoordinate=deconstruct.XComponent, YCoordinate=deconstruct.YComponent, ZCoordinate=0)
point_groups = PointGroups(Points=construct_point, Distance=Slider(2, range=0..10))  # -> Groups, Indices
list_item = ListItem(Index=point_groups.Indices, Wrap=True)
list_item_2 = ListItem(List=deconstruct.ZComponent, Index=point_groups.Indices, Wrap=True)
sort_list = SortList(Keys=list_item_2, ValuesValuesA=list_item)  # -> Keys, simplify(ValuesValuesA)
curve = Curve(sort_list.ValuesValuesA)
explode_tree = ExplodeTree(Data=curve)  # -> Branch0, Branch1, Branch2, Branch3
curve_2 = Curve(explode_tree.Branch0)
curve_3 = Curve(explode_tree.Branch1)
curve_4 = Curve(explode_tree.Branch2)
curve_5 = Curve(explode_tree.Branch3)
loft = Loft(Curves=curve_2, Options={Adjust=False, Closed=False, LoftEnds=0, LoftSimp=0, LoftType=0, Rebuild=10, Refit=0.01})
loft_2 = Loft(Curves=curve_3, Options={Adjust=False, Closed=False, LoftEnds=0, LoftSimp=0, LoftType=0, Rebuild=10, Refit=0.01})
loft_3 = Loft(Curves=curve_4, Options={Adjust=False, Closed=False, LoftEnds=0, LoftSimp=0, LoftType=0, Rebuild=10, Refit=0.01})
loft_4 = Loft(Curves=curve_5, Options={Adjust=False, Closed=False, LoftEnds=0, LoftSimp=0, LoftType=0, Rebuild=10, Refit=0.01})
cap_holes = CapHoles(Brep=loft)
cap_holes_2 = CapHoles(Brep=loft_2)
cap_holes_3 = CapHoles(Brep=loft_3)
cap_holes_4 = CapHoles(Brep=loft_4)
mesh_brep = MeshBrep(
    Brep=cap_holes,
    Settings={GridMaxCount=0, GridMinCount=16, JaggedSeams=False, MaxEdgeLength=0, MinEdgeLength=0.0001, MinTolerance=0, Refine=True, RefineAngle=0, RelativeTolerance=0.65, SimplePlanes=True, Tolerance=0})
mesh_brep_2 = MeshBrep(
    Brep=cap_holes_2,
    Settings={GridMaxCount=0, GridMinCount=16, JaggedSeams=False, MaxEdgeLength=0, MinEdgeLength=0.0001, MinTolerance=0, Refine=True, RefineAngle=0, RelativeTolerance=0.65, SimplePlanes=True, Tolerance=0})
mesh_brep_3 = MeshBrep(
    Brep=cap_holes_3,
    Settings={GridMaxCount=0, GridMinCount=16, JaggedSeams=False, MaxEdgeLength=0, MinEdgeLength=0.0001, MinTolerance=0, Refine=True, RefineAngle=0, RelativeTolerance=0.65, SimplePlanes=True, Tolerance=0})
mesh_brep_4 = MeshBrep(
    Brep=cap_holes_4,
    Settings={GridMaxCount=0, GridMinCount=16, JaggedSeams=False, MaxEdgeLength=0, MinEdgeLength=0.0001, MinTolerance=0, Refine=True, RefineAngle=0, RelativeTolerance=0.65, SimplePlanes=True, Tolerance=0})
merge = Merge(Data1=mesh_brep, Data2=mesh_brep_2, Data3=mesh_brep_3, Data4=mesh_brep_4)
mesh = Mesh(merge)
panel = Panel(mesh)

context_bake = ContextBake(Content=mesh)
